# Dynamo graph elevationsbySpace.dyn "elevationbyspace" (Dynamo 2.0.3.8810)

categories = Categories(index=457)  # graph input
all_elements_of_category = ElementsOfCategory(Category=categories)
python_script = Python(IN[0]=all_elements_of_category)
# ---------- python_script.python (33 lines) ----------
import clr
# Import Element wrapper extension methods
clr.AddReference("RevitNodes")
import Revit
clr.ImportExtensions(Revit.Elements)
clr.AddReference('ProtoGeometry')
from Autodesk.DesignScript.Geometry import *
# Import DocumentManager and TransactionManager
clr.AddReference("RevitServices")
import RevitServices
from RevitServices.Persistence import DocumentManager
from RevitServices.Transactions import TransactionManager
doc = DocumentManager.Instance.CurrentDBDocument
clr.ImportExtensions(Revit.GeometryConversion)
import sys
pyt_path = r'C:\Program Files (x86)\IronPython 2.7\Lib'
sys.path.append(pyt_path)

# Import RevitAPI
clr.AddReference("RevitAPI")
import Autodesk
from Autodesk.Revit.DB import *
inspaces = UnwrapElement(IN[0])
opt = SpatialElementBoundaryOptions()
bnd = [i.GetBoundarySegments(opt) for i in inspaces]
curves = []

for i in bnd:
	curves.append([s.GetCurve().ToProtoType() for s in i[0]])

	
	
OUT = curves,[h.UnboundedHeight * 304.8 for h in inspaces]
# ----------------------------------------
code_block = CodeBlock(a=python_script) { a[0]; }
flatten = List.Flatten(list=code_block@L2)
python_script_2 = Python(IN[0]=flatten)
# ---------- python_script_2.python (43 lines) ----------
#Copyright(c) 2017 www.Learndynamo.com 
#Please contact at jeremy@learndynamo.com

import clr
clr.AddReference('ProtoGeometry')
from Autodesk.DesignScript.Geometry import *
#The inputs to this node will be stored as a list in the IN variables.
curveLists = IN[0]

output = []

def checkCurves(curve1, curve2):
	v1 = curve1.Direction.Normalized()
	v2 = curve2.Direction.Normalized()
	if Vector.IsAlmostEqualTo(v1,v2):
		newLine = Line.ByStartPointEndPoint(curve2.StartPoint, curve1.EndPoint)
		return newLine
	else:
		return curve1

for list in curveLists:
	count = 0
	newCurves = []
	for curve in list:
		if count == 0:
			newCurves.append(curve)
		else:
			newCurve = checkCurves(curve, newCurves[len(newCurves)-1])
			if newCurve == curve:
				newCurves.append(curve)
			else:
				newCurves[len(newCurves)-1] = newCurve				
		count += 1
	
	if Vector.IsAlmostEqualTo(newCurves[0].Direction.Normalized(),newCurves[len(newCurves)-1].Direction.Normalized()):
		newCurve = Line.ByStartPointEndPoint(newCurves[len(newCurves)-1].StartPoint, newCurves[0].EndPoint)
		newCurves.pop()
		newCurves[0] = newCurve	
			
	output.append(newCurves)	

#Assign your output to the OUT variable.
OUT = output
# ----------------------------------------
reverse = Curve.Reverse(curve=python_script_2)
direction = Line.Direction(line=reverse)
ZAxis = Vector.ZAxis()
cross = Vector.Cross(vector=direction, cross=ZAxis)
number_slider = DoubleSlider(1.5, range=0..100 step 0.1)  # graph input
translate = Geometry.Translate(geometry=python_script_2, direction=cross, distance=number_slider)
element_types = ElementTypes(index=332)  # graph input
all_elements_of_type = ElementsOfType(element_type=element_types)
name = Element.Name(element=all_elements_of_type)
string = StringInput("Interior Elevation")  # graph input
eq = name == string
filterByBoolMask = List.FilterByBoolMask(list=all_elements_of_type, mask=eq)
python_script_3 = Python(IN[0]=filterByBoolMask.in)
# ---------- python_script_3.python (17 lines) ----------
#Copyright(c) 2017 www.Learndynamo.com 
#Please contact at jeremy@learndynamo.com

import clr
clr.AddReference("RevitAPI")
import Autodesk

#The inputs to this node will be stored as a list in the IN variables.
viewFamilyTypes = UnwrapElement(IN[0])

output = []

for type in viewFamilyTypes:
	output.append(type.FamilyName)

#Assign your output to the OUT variable.
OUT = output
# ----------------------------------------
string_2 = StringInput("Elevation")  # graph input
eq_2 = python_script_3 == string_2
boolean = BoolSelector(true)  # graph input
firstIndexOf = List.FirstIndexOf(list=eq_2, item=boolean)
getItemAtIndex = List.GetItemAtIndex(list=filterByBoolMask.in, index=firstIndexOf)
views = Views(index=2)  # graph input
# note: Juggernaught 1.1
elevationByCurve = Revit.View.ElevationByCurve(Curve=translate, ViewFamilyType=getItemAtIndex, ViewPlan=views)
code_block_2 = CodeBlock(a=python_script) { a[1]; }
python_script_4 = Python(IN[0]=translate, IN[1]=elevationByCurve.Elevation, IN[2]=code_block_2)
# ---------- python_script_4.python (70 lines) ----------
#Copyright(c) 2017 www.Learndynamo.com 
#Please contact at jeremy@learndynamo.com

import clr
clr.AddReference('ProtoGeometry')
from Autodesk.DesignScript.Geometry import *

clr.AddReference("RevitServices")
import RevitServices
from RevitServices.Persistence import DocumentManager
from RevitServices.Transactions import TransactionManager

clr.AddReference("RevitAPI")
import Autodesk

clr.AddReference("RevitNodes")
import Revit
clr.ImportExtensions(Revit.Elements)
clr.ImportExtensions(Revit.GeometryConversion)

#The inputs to this node will be stored as a list in the IN variables.
curves = IN[0]
views = UnwrapElement(IN[1])
heights = IN[2]
output = []
doc = DocumentManager.Instance.CurrentDBDocument

getDocUnits = doc.GetUnits()
getDisplayUnits = getDocUnits.GetFormatOptions(Autodesk.Revit.DB.UnitType.UT_Length).DisplayUnits

for curveList, viewList, height in zip(curves, views, heights):

	height = Autodesk.Revit.DB.UnitUtils.ConvertFromInternalUnits(height, getDisplayUnits )
	
	tempList = []
	for curve, view in zip(curveList,viewList):
		
		viewCropManager = view.GetCropRegionShapeManager()		
		cLoop = viewCropManager.GetCropShape()[0]
		cLoopCurves = [x.ToProtoType() for x in cLoop]
		
		PointA = cLoopCurves[3].EndPoint
		PointD = cLoopCurves[3].StartPoint
		curveMP = Curve.PointAtParameter(curve, 0.5)

		if Geometry.DistanceTo(curveMP,curve.EndPoint) < Geometry.DistanceTo(curveMP, PointA):
			PointA = curve.EndPoint		
			
		if Geometry.DistanceTo(curveMP,curve.StartPoint) < Geometry.DistanceTo(curveMP, PointD):
			PointD = curve.StartPoint			
		
		PointB = Point.ByCoordinates(PointA.X, PointA.Y, PointA.Z + height)
		PointC = Point.ByCoordinates(PointD.X, PointD.Y, PointD.Z + height)
			
		LineA = Line.ByStartPointEndPoint(PointA,PointB).ToRevitType()
		LineB = Line.ByStartPointEndPoint(PointB,PointC).ToRevitType()
		LineC = Line.ByStartPointEndPoint(PointC,PointD).ToRevitType()
		LineD = Line.ByStartPointEndPoint(PointD,PointA).ToRevitType()
		
		curveLoop = Autodesk.Revit.DB.CurveLoop.Create([LineA, LineB, LineC, LineD])

		TransactionManager.Instance.EnsureInTransaction(doc)		
		viewCropManager.SetCropShape(curveLoop)
		TransactionManager.Instance.TransactionTaskDone()
		
		tempList.append(view.ToDSType(False))

	output.append(tempList)
#Assign your output to the OUT variable.
OUT = output
# ----------------------------------------
